# Grasshopper definition Arte Architettura Design Marcello Morandini.gh (Grasshopper 1.0.7)

xz_plane = XZPlane(Origin=Point(0, 0, 0))
number_slider = Slider(11, range=1..20)
plane_surface = PlaneSurface(Plane=xz_plane, XSize="24", YSize="220")
subtraction = Subtraction(A=number_slider, B="1")
divide_domain² = DivideDomain²(Domain=plane_surface, UCount=number_slider, VCount=number_slider)
construct_domain = ConstructDomain(DomainStart=Slider(100, range=0..100), DomainEnd=Slider(10, range=0..100))
isotrim = Isotrim(Surface=plane_surface, Domain=divide_domain²)
range = Range(Domain=construct_domain, Steps=subtraction)
construct_domain_2 = ConstructDomain(DomainStart="120", DomainEnd=range)
range_2 = Range(Domain=construct_domain_2, Steps=subtraction)
partition_list = PartitionList(List=isotrim, Size=number_slider)
unit_y = UnitY(Factor=range_2)
flip_matrix = FlipMatrix(Data=partition_list)
negative = Negative(Value=unit_y)
extrude = Extrude(Base=flip_matrix, Direction=negative)
yz_plane = YZPlane(Origin=Point(0, 0, 0))
mirror = Mirror(Geometry=extrude, Plane=yz_plane)  # -> Geometry, Transform
merge = Merge(Data1=extrude, Data2=mirror.Geometry)
