# Grasshopper definition Epcots Spaceship Earth.gh (Grasshopper 1.0.7)

subd = SubD(<subd referenced from the Rhino model>)
face_boundaries = FaceBoundaries(Mesh=subd)
area = Area(Geometry=face_boundaries)  # -> Area, Centroid
is_planar = IsPlanar(Surface=face_boundaries, Interior=True)  # -> Planar, Plane
amplitude = Amplitude(Vector=is_planar.Plane, Amplitude=Slider(0.37, range=0..1))
move = Move(Geometry=area.Centroid, Motion=amplitude)  # -> Geometry, Transform
extrude_point = ExtrudePoint(Base=face_boundaries, Point=move.Geometry)
deconstruct_brep = DeconstructBrep(Brep=extrude_point)  # -> Faces, Edges, Vertices
area_2 = Area(Geometry=deconstruct_brep.Faces)  # -> Area, Centroid
scale = Scale(Geometry=deconstruct_brep.Faces, Center=area_2.Centroid, Factor=Slider(0.95, range=0..1))  # -> Geometry, Transform
merge = Merge(Data1=graft(deconstruct_brep.Faces), Data2=graft(scale.Geometry))
loft = Loft(Curves=merge, Options={Adjust=False, Closed=False, LoftEnds=0, LoftSimp=0, LoftType=0, Rebuild=10, Refit=0.01})
custom_preview = CustomPreview(Geometry=loft, Material=ColourSwatch(SwatchColor=RGB(255, 255, 255)))
